# Dynamo custom node GroupHasExclusions.dyf "© Groups.HasExclusions" (Dynamo 2.3.0.5885)
# category: Crumple.Revit.Query
# Returns a boolean as to whether a group contains excluded elements.

group = Input(group: var[]..[])
python_script = Python(IN[0]=group)
# ---------- python_script.python (20 lines) ----------
# Boilerplate text
import clr

def uwlist(input):
    result = input if isinstance(input, list) else [input]
    return UnwrapElement(result)

# Preparing input from dynamo to revit
groups = uwlist(IN[0])
excluded = []

# Check for excluded elements
for group in groups:
	hasexcluded = False
	if "excluded" in group.Name:
			hasexcluded = True
	excluded.append(hasexcluded)

# Preparing output to Dynamo
OUT = excluded
# ----------------------------------------
hasExcluded = Output(python_script)
